# Grasshopper definition doodle sim complex.gh (Grasshopper 0.9.56)

y = Slider(100, range=0..150)
x = Slider(10, range=0..150)
l2_elbow = Number("88")
l1_shoulder = Number("80.4")
y_2 = Number(y)
x_2 = Number(x)
cb2 = Evaluate(F="2*x*y", x=l1_shoulder, y=l2_elbow)
c2 = Evaluate(F="(x^2+y^2-l1^2-l2^2)/cb2", x=x_2, y=y_2, l1=l1_shoulder, l2=l2_elbow, cb2=cb2)
k1 = Evaluate(F="l1+l2*c2", l1=l1_shoulder, l2=l2_elbow, c2=c2)
s2 = Evaluate(F="(1-c2²)^.5", c2=c2)
k2 = Evaluate(F="l2*s2", l2=l2_elbow, s2=s2)
base_angle = Evaluate(F="deg(atan2(y,x)-atan2(k2,k1))", x=x_2, y=y_2, k1=k1, k2=k2)
elbow_angle = Evaluate(F="deg(atan2(s2,c2))", s2=s2, c2=c2)
panel = Panel(base_angle)
panel_2 = Panel(elbow_angle)

subtraction = Subtraction(A=elbow_angle, B=90)
num = Number(base_angle)

rotate_angle_elbow = Slider(50, range=10..120)
angle_sholder = Slider(24, range=0..180)
lower_arm_and_motor = Geometry([<brep referenced from the Rhino model> x5])
num_2 = Number(subtraction)
upper_crank_point = Point(<point referenced from the Rhino model>)
pt_elbow_crank = Point(<point referenced from the Rhino model>)
uppper_arm = Geometry([<point referenced from the Rhino model> x2, <brep referenced from the Rhino model> x11, <curve referenced from the Rhino model>, <brep referenced from the Rhino model>])
pt_sholder = Point(<point referenced from the Rhino model>)
crank_handle = Geometry(<brep referenced from the Rhino model>)
pt_elbow = Point(<point referenced from the Rhino model>)
crank_point = Point(<point referenced from the Rhino model>)
crank = Geometry([<brep referenced from the Rhino model> x3])
grp = Group([lower_arm_and_motor, pt_elbow, pt_elbow_crank, crank, crank_handle, crank_point, upper_crank_point, uppper_arm])
rad = Radians(Degrees=num)
Z = UnitZ(Factor=1)
move = Move(Geometry=pt_sholder, Motion=expr("-t", Z))  # -> Geometry, Transform
rad_2 = Radians(Degrees=num_2)
sholder_plane = Plane3Pt(PointA=pt_sholder, PointB=move.Geometry, PointC=pt_elbow)
rotate = Rotate(Geometry=grp, Angle=rad, Plane=sholder_plane)  # -> Geometry, Transform
elbow_crank = ListItem(List=rotate.Geometry, Index=6, Wrap=True)
elbow_pt = ListItem(List=rotate.Geometry, Index=5, Wrap=True)
ungroup = Ungroup(Group=elbow_crank)
ungroup_2 = Ungroup(Group=elbow_pt)
split = SplitList(List=rotate.Geometry, Index=Slider(11, range=0..100))  # -> ListA, ListB
split_2 = SplitList(List=split.ListA, Index=Slider(6, range=0..100))  # -> ListA, ListB
geo = Geometry(split_2.ListB)
grp_2 = Group(split.ListB)
elbow_plane = Plane3Pt(PointA=ungroup_2, PointB=ungroup, PointC=pt_sholder)
split_3 = SplitList(List=grp_2, Index=Slider(2, range=0..16))  # -> ListA, ListB
rad_3 = Radians(Degrees=num_2)
rotate_2 = Rotate(Geometry=split_3.ListB, Angle=rad_2, Plane=elbow_plane)  # -> Geometry, Transform
elbow_upper_point = ListItem(List=rotate_2.Geometry, Index=0, Wrap=True)
split_4 = SplitList(List=split.ListA, Index=Slider(7, range=0..100))  # -> ListA, ListB
motor_points = Geometry(split_3.ListA)
ungroup_3 = Ungroup(Group=elbow_upper_point)
motor_point = ListItem(List=motor_points, Index=0, Wrap=True)
motor_upper_point = ListItem(List=motor_points, Index=1, Wrap=True)
ungroup_4 = Ungroup(Group=motor_point)
ungroup_5 = Ungroup(Group=motor_upper_point)
motor_plane = Plane3Pt(PointA=ungroup_4, PointB=ungroup_5, PointC=pt_sholder)
rotate_3 = Rotate(Geometry=[geo, ungroup_5], Angle=rad_3, Plane=motor_plane)  # -> Geometry, Transform
split_5 = SplitList(List=rotate_3.Geometry, Index=Slider(4, range=0..100))  # -> flatten(ListA), ListB
ungroup_6 = Ungroup(Group=split_5.ListA)  # -> flatten(Objects)
geo_2 = Geometry(ungroup_6)
item = ListItem(List=geo_2, Index=1, Wrap=True)
subtraction_2 = Subtraction(A=num_2, B=360)
pl_3pt = Plane3Pt(PointA=item, PointB=ungroup_3, PointC=ungroup_4)
rad_4 = Radians(Degrees=subtraction_2)
rotate_4 = Rotate(Geometry=geo_2, Angle=rad_4, Plane=pl_3pt)  # -> Geometry, Transform
swatch = ColourSwatch(SwatchColor=RGB(184, 185, 188))
preview = CustomPreview(Geometry=[rotate_2.Geometry, split_5.ListB, rotate_4.Geometry], Shader=swatch)
preview_2 = CustomPreview(Geometry=split_4.ListA, Shader=swatch)
