# Grasshopper definition doodle sim scara arm 2.gh (Grasshopper 0.9.56)

# ----
# forward kinematics
pt = ConstructPoint(XCoordinate=0, YCoordinate=0, ZCoordinate=0)
elbow = Slider(121.86, range=0..180)
pt_2 = Point(pt)  # disabled
number_slider = Slider(20, range=0..100)
shoulder = Slider(34.25, range=0..90)
rad = Radians(Degrees=elbow)
cir = Circle(Plane=pt_2, Radius=number_slider)
cir_2 = Circle(Plane=pt_2, Radius="80.4")
rad_2 = Radians(Degrees=shoulder)
rotate = Rotate(Geometry=cir, Angle=rad, Plane=PlaneXY(0, 0, 0))  # -> Geometry, Transform
rotate_2 = Rotate(Geometry=cir_2, Angle=rad_2, Plane=PlaneXY(0, 0, 0))  # -> Geometry, Transform
eval = EvaluateCurve(Curve=rotate.Geometry, Parameter="0")  # -> Point, Tangent, Angle
ln = Line(StartPoint=eval.Point, EndPoint=pt_2)
eval_2 = EvaluateCurve(Curve=rotate_2.Geometry, Parameter="0")  # -> Point, Tangent, Angle
ln_2 = Line(StartPoint=pt_2, EndPoint=eval_2.Point)
cir_3 = Circle(Plane=eval_2.Point, Radius=number_slider)
rotate_3 = Rotate(Geometry=cir_3, Angle=rad, Plane=eval_2.Point)  # -> Geometry, Transform
eval_3 = EvaluateCurve(Curve=rotate_3.Geometry, Parameter="0")  # -> Point, Tangent, Angle
ln_3 = Line(StartPoint=eval_3.Point, EndPoint=eval.Point)
cir_4 = Circle(Plane=eval_2.Point, Radius="88")
rotate_4 = Rotate(Geometry=cir_4, Angle=rad, Plane=eval_2.Point)  # -> Geometry, Transform
eval_4 = EvaluateCurve(Curve=rotate_4.Geometry, Parameter="0")  # -> Point, Tangent, Angle
ln_4 = Line(StartPoint=eval_2.Point, EndPoint=eval_4.Point)
pdecon = Deconstruct(Point=eval_4.Point)  # -> XComponent, YComponent, ZComponent
x = Panel(pdecon.XComponent)
y = Panel(pdecon.YComponent)

# ----
# inverse kinematics
x_2 = Slider(90, range=0..90)
y_2 = Slider(94.015, range=0..150)
x_3 = Number(x_2)
y_3 = Number(y_2)
h = Evaluate(F="sqrt(x^2+y^2)", x=x_3, y=y_3)
l2_elbow = Number("88")
l1_shoulder = Number("80.4")
ang_a = Evaluate(F="Acos((L1^2+L2^2-(h^2))/(2*L1*L2))", x=x_3, y=y_3, L1=l1_shoulder, L2=l2_elbow, h=h)
ang_d = Evaluate(F="atan(x/y)", x=x_3, y=y_3)
deg = Degrees(Radians=ang_a)
deg_2 = Degrees(Radians=ang_d)
ang_b = Evaluate(F="180-AngA", AngA=deg)
ang_c = Evaluate(F="Acos((L1^2-L2^2+x^2+y^2)/(2*L1*h))", x=x_3, y=y_3, L1=l1_shoulder, L2=l2_elbow, h=h)
deg_3 = Degrees(Radians=ang_c)
ang_1_elbow = Evaluate(F="90-(AngC+AngD-AngB)", AngD=deg_2, AngB=ang_b, AngC=deg_3)
ang_2_shoulder = Evaluate(F="Ang1-AngB", Ang1=ang_1_elbow, AngB=ang_b)

# ----
# inverse kinematics
upper_arm_2 = Slider(102.24, range=0..180)
lower_arm = Slider(77.328, range=0..90)
pt_3 = ConstructPoint(XCoordinate=0, YCoordinate=0, ZCoordinate=0)
pt_4 = Point(pt_3)
number_slider_2 = Slider(20, range=0..100)
rad_3 = Radians(Degrees=ang_1_elbow)
cir_5 = Circle(Plane=pt_4, Radius=number_slider_2)
cir_6 = Circle(Plane=pt_4, Radius="80.4")
rad_4 = Radians(Degrees=ang_2_shoulder)
rotate_5 = Rotate(Geometry=cir_5, Angle=rad_3, Plane=PlaneXY(0, 0, 0))  # -> Geometry, Transform
rotate_6 = Rotate(Geometry=cir_6, Angle=rad_4, Plane=PlaneXY(0, 0, 0))  # -> Geometry, Transform
eval_5 = EvaluateCurve(Curve=rotate_5.Geometry, Parameter="0")  # -> Point, Tangent, Angle
ln_5 = Line(StartPoint=eval_5.Point, EndPoint=pt_4)
eval_6 = EvaluateCurve(Curve=rotate_6.Geometry, Parameter="0")  # -> Point, Tangent, Angle
ln_6 = Line(StartPoint=pt_4, EndPoint=eval_6.Point)
cir_7 = Circle(Plane=eval_6.Point, Radius=number_slider_2)
rotate_7 = Rotate(Geometry=cir_7, Angle=rad_3, Plane=eval_6.Point)  # -> Geometry, Transform
eval_7 = EvaluateCurve(Curve=rotate_7.Geometry, Parameter="0")  # -> Point, Tangent, Angle
ln_7 = Line(StartPoint=eval_7.Point, EndPoint=eval_5.Point)
cir_8 = Circle(Plane=eval_6.Point, Radius="88")
rotate_8 = Rotate(Geometry=cir_8, Angle=rad_3, Plane=eval_6.Point)  # -> Geometry, Transform
eval_8 = EvaluateCurve(Curve=rotate_8.Geometry, Parameter="0")  # -> Point, Tangent, Angle
ln_8 = Line(StartPoint=eval_6.Point, EndPoint=eval_8.Point)
pdecon_2 = Deconstruct(Point=eval_8.Point)  # -> XComponent, YComponent, ZComponent
x_4 = Panel(pdecon_2.XComponent)
y_4 = Panel(pdecon_2.YComponent)

panel = Panel(ang_1_elbow)
panel_2 = Panel(ang_2_shoulder)
