# Grasshopper definition doodle sim scara arm.gh (Grasshopper 0.9.56)

# ----
# forward kinematics
pt = ConstructPoint(XCoordinate=0, YCoordinate=0, ZCoordinate=0)
upper_arm_2 = Slider(94.464, range=0..180)
pt_2 = Point(pt)
number_slider = Slider(20, range=0..100)
lower_arm = Slider(28.944, range=0..90)
rad = Radians(Degrees=upper_arm_2)
cir = Circle(Plane=pt_2, Radius=number_slider)
cir_2 = Circle(Plane=pt_2, Radius="80.4")
rad_2 = Radians(Degrees=lower_arm)
rotate = Rotate(Geometry=cir, Angle=rad, Plane=PlaneXY(0, 0, 0))  # -> Geometry, Transform
rotate_2 = Rotate(Geometry=cir_2, Angle=rad_2, Plane=PlaneXY(0, 0, 0))  # -> Geometry, Transform
eval = EvaluateCurve(Curve=rotate.Geometry, Parameter="0")  # -> Point, Tangent, Angle
ln = Line(StartPoint=eval.Point, EndPoint=pt_2)
eval_2 = EvaluateCurve(Curve=rotate_2.Geometry, Parameter="0")  # -> Point, Tangent, Angle
ln_2 = Line(StartPoint=pt_2, EndPoint=eval_2.Point)
cir_3 = Circle(Plane=eval_2.Point, Radius=number_slider)
rotate_3 = Rotate(Geometry=cir_3, Angle=rad, Plane=eval_2.Point)  # -> Geometry, Transform
eval_3 = EvaluateCurve(Curve=rotate_3.Geometry, Parameter="0")  # -> Point, Tangent, Angle
ln_3 = Line(StartPoint=eval_3.Point, EndPoint=eval.Point)
cir_4 = Circle(Plane=eval_2.Point, Radius="88")
rotate_4 = Rotate(Geometry=cir_4, Angle=rad, Plane=eval_2.Point)  # -> Geometry, Transform
eval_4 = EvaluateCurve(Curve=rotate_4.Geometry, Parameter="0")  # -> Point, Tangent, Angle
ln_4 = Line(StartPoint=eval_2.Point, EndPoint=eval_4.Point)
pdecon = Deconstruct(Point=eval_4.Point)  # -> XComponent, YComponent, ZComponent
x = Panel(pdecon.XComponent)
y = Panel(pdecon.YComponent)

# ----
# formulas used for inverse kinematics: float l1 = 80.4; // the length of the shoulder
#   float l2 = 88; // the length of the elbow
# 
# 
#   double cb2 = 2*l1*l2;
# 
#   double c2 = (sq(x) + sq(y) - sq(l1) - sq (l2)) / cb2;
#   double s2 = sqrt(1-sq(c2));
#   double k1 = (l1 + l2 * c2);
#   double k2 = (l2 * s2);
# 
#   double base_ang = rtod((atan2(y,x) - atan2(k2,k1)));
#   double elbow_ang = rtod(atan2(s2,c2)) + 90;
# 
#   myservo1.write(base_ang);
#   myservo2.write(elbow_ang);
# inverse kinematics
panel = Panel("20")

y_2 = Slider(50.932, range=0..150)
x_2 = Slider(53.616, range=0..150)
l1_shoulder = Number("80.4")
l2_elbow = Number(panel)
y_3 = Number(y_2)
x_3 = Number(x_2)
cb2 = Evaluate(F="2*x*y", x=l1_shoulder, y=l2_elbow)
c2 = Evaluate(F="(x^2+y^2-l1^2-l2^2)/cb2", x=x_3, y=y_3, l1=l1_shoulder, l2=l2_elbow, cb2=cb2)
k1 = Evaluate(F="l1+l2*c2", l1=l1_shoulder, l2=l2_elbow, c2=c2)
s2 = Evaluate(F="(1-c2²)^.5", c2=c2)
k2 = Evaluate(F="l2*s2", l2=l2_elbow, s2=s2)
base_angle = Evaluate(F="deg(atan2(y,x)-atan2(k2,k1))", x=x_3, y=y_3, k1=k1, k2=k2)
elbow_angle = Evaluate(F="deg(atan2(s2,c2))", s2=s2, c2=c2)
panel_2 = Panel(base_angle)
panel_3 = Panel(elbow_angle)

subtraction = Subtraction(A=elbow_angle, B=base_angle)
subtraction_2 = Subtraction(A=subtraction, B=180)
subtraction_3 = Subtraction(A=180, B=subtraction)

# ----
# inverse kinematics
upper_arm_2_2 = Slider(102.24, range=0..180)
lower_arm_2 = Slider(77.328, range=0..90)
pt_3 = ConstructPoint(XCoordinate=0, YCoordinate=0, ZCoordinate=0)
pt_4 = Point(pt_3)
number_slider_2 = Slider(20, range=0..100)
rad_3 = Radians(Degrees=subtraction_3)
cir_5 = Circle(Plane=pt_4, Radius=number_slider_2)
cir_6 = Circle(Plane=pt_4, Radius="80.4")
rad_4 = Radians(Degrees=base_angle)
rotate_5 = Rotate(Geometry=cir_5, Angle=rad_3, Plane=PlaneXY(0, 0, 0))  # -> Geometry, Transform
rotate_6 = Rotate(Geometry=cir_6, Angle=rad_4, Plane=PlaneXY(0, 0, 0))  # -> Geometry, Transform
eval_5 = EvaluateCurve(Curve=rotate_5.Geometry, Parameter="0")  # -> Point, Tangent, Angle
ln_5 = Line(StartPoint=eval_5.Point, EndPoint=pt_4)
eval_6 = EvaluateCurve(Curve=rotate_6.Geometry, Parameter="0")  # -> Point, Tangent, Angle
ln_6 = Line(StartPoint=pt_4, EndPoint=eval_6.Point)
cir_7 = Circle(Plane=eval_6.Point, Radius=number_slider_2)
rotate_7 = Rotate(Geometry=cir_7, Angle=rad_3, Plane=eval_6.Point)  # -> Geometry, Transform
eval_7 = EvaluateCurve(Curve=rotate_7.Geometry, Parameter="0")  # -> Point, Tangent, Angle
ln_7 = Line(StartPoint=eval_7.Point, EndPoint=eval_5.Point)
cir_8 = Circle(Plane=eval_6.Point, Radius="88")
rotate_8 = Rotate(Geometry=cir_8, Angle=rad_3, Plane=eval_6.Point)  # -> Geometry, Transform
eval_8 = EvaluateCurve(Curve=rotate_8.Geometry, Parameter="0")  # -> Point, Tangent, Angle
ln_8 = Line(StartPoint=eval_6.Point, EndPoint=eval_8.Point)
pdecon_2 = Deconstruct(Point=eval_8.Point)  # -> XComponent, YComponent, ZComponent
x_4 = Panel(pdecon_2.XComponent)
y_4 = Panel(pdecon_2.YComponent)

panel_4 = Panel(subtraction_3)
