# Grasshopper definition doodle sim screw arm vertical screw.gh (Grasshopper 0.9.65)

elbow = Slider(100, range=0..100)
base = Slider(0, range=0..100)
# formulas used for inverse kinematics: float l1 = 80.4; // the length of the shoulder
#   float l2 = 88; // the length of the elbow
# 
# 
#   double cb2 = 2*l1*l2;
# 
#   double c2 = (sq(x) + sq(y) - sq(l1) - sq (l2)) / cb2;
#   double s2 = sqrt(1-sq(c2));
#   double k1 = (l1 + l2 * c2);
#   double k2 = (l2 * s2);
# 
#   double base_ang = rtod((atan2(y,x) - atan2(k2,k1)));
#   double elbow_ang = rtod(atan2(s2,c2)) + 90;
# 
#   myservo1.write(base_ang);
#   myservo2.write(elbow_ang);
panel = Panel("88")

# ---- group: y
# inverse kinematics
# motor steps
# base motor : .18 degrees per step
# in one revolution 2000 steps
# 
# for 1 degree : 5.55 steps 88.8
y = Slider(105.614, range=0..150)
x = Slider(61.069, range=0..150)
l1_shoulder = Number("80.4")
l2_elbow = Number(panel)
x_2 = Number(x)
y_2 = Number(y)
cb2 = Evaluate(F="2*x*y", x=l1_shoulder, y=l2_elbow)
c2 = Evaluate(F="(x^2+y^2-l1^2-l2^2)/cb2", x=x_2, y=y_2, l1=l1_shoulder, l2=l2_elbow, cb2=cb2)
k1 = Evaluate(F="l1+l2*c2", l1=l1_shoulder, l2=l2_elbow, c2=c2)
s2 = Evaluate(F="(1-c2²)^.5", c2=c2)
k2 = Evaluate(F="l2*s2", l2=l2_elbow, s2=s2)
base_angle = Evaluate(F="deg(atan2(y,x)-atan2(k2,k1))", x=x_2, y=y_2, k1=k1, k2=k2)
elbow_angle = Evaluate(F="deg(atan2(s2,c2))", s2=s2, c2=c2)
panel_2 = Panel(base_angle)
panel_3 = Panel(elbow_angle)

# ----
panel_4 = Panel("""35.92,96.26
35.44,96.211""")

# ----
# forward kinematics
pt = ConstructPoint(XCoordinate=0, YCoordinate=0, ZCoordinate=0)  # disabled
pt_2 = Point(pt)
Y = UnitY(Factor=Slider(-6, range=-100..100))
move = Move(Geometry=pt_2, Motion=Y)  # -> Geometry, Transform
X = UnitX(Factor=1)
rad = Radians(Degrees=base_angle)
cir = Circle(Plane=pt_2, Radius="80.4")
number_slider = Slider(19, range=0..100)
line = LineSDL(Start=move.Geometry, Direction=X, Length=Slider(56, range=0..100))
rotate = Rotate(Geometry=cir, Angle=rad, Plane=PlaneXY(0, 0, 0))  # -> Geometry, Transform
eval = EvaluateCurve(Curve=rotate.Geometry, Parameter="0")  # -> Point, Tangent, Angle
ln = Line(StartPoint=pt_2, EndPoint=eval.Point)
eval_2 = EvaluateLength(Curve=ln, Length=number_slider, Normalized=False)  # -> Point, Tangent, Parameter
cir_2 = Circle(Plane=eval_2.Point, Radius=Slider(25, range=0..100))
offset = Offset(Curve=ln, Distance=expr("-d", Slider(10, range=0..100)), Plane=PlaneXY(0, 0, 0), Corners=1)
end = EndPoints(Curve=offset)  # -> Start, End
Z = UnitZ(Factor=1)
Y_2 = UnitY(Factor=1)
move_2 = Move(Geometry=eval.Point, Motion=Y_2)  # -> Geometry, Transform
pl_3pt = Plane3Pt(PointA=eval.Point, PointB=pt_2, PointC=move_2.Geometry)
rad_2 = Radians(Degrees=elbow_angle)
move_3 = Move(Geometry=eval.Point, Motion=Z)  # -> Geometry, Transform
pl_3pt_2 = Plane3Pt(PointA=eval.Point, PointB=pt_2, PointC=move_3.Geometry)
rad_3 = Radians(Degrees=90)
number_slider_2 = Slider(50, range=0..100)
rotate_2 = Rotate(Geometry=pl_3pt_2, Angle=rad_3, Plane=pl_3pt)  # -> Geometry, Transform
mirror = Mirror(Geometry=pl_3pt, Plane=rotate_2.Geometry)  # -> Geometry, Transform
cir_3 = Circle(Plane=mirror.Geometry, Radius="88")
rotate_3 = Rotate(Geometry=cir_3, Angle=rad_2, Plane=mirror.Geometry)  # -> Geometry, Transform
eval_3 = EvaluateCurve(Curve=rotate_3.Geometry, Parameter="0")  # -> Point, Tangent, Angle
cir_4 = Circle(Plane=eval_3.Point, Radius="6")
ln_2 = Line(StartPoint=eval.Point, EndPoint=eval_3.Point)
eval_4 = EvaluateLength(Curve=ln_2, Length=Slider(19, range=0..100), Normalized=False)  # -> Point, Tangent, Parameter

eval_5 = EvaluateLength(Curve=line, Length=number_slider, Normalized=False)  # -> Point, Tangent, Parameter
eval_6 = EvaluateLength(Curve=offset, Length=Slider(13, range=0..100), Normalized=False)  # -> Point, Tangent, Parameter

ln_3 = Line(StartPoint=eval_5.Point, EndPoint=eval_2.Point)
dist = Distance(PointA=eval_5.Point, PointB=eval_2.Point)
dist_2 = Distance(PointA=eval_4.Point, PointB=eval_6.Point)
base_screw_length = Panel(dist)
elbow_screw_length = Panel(dist_2)
ln_4 = Line(StartPoint=eval_6.Point, EndPoint=eval_4.Point)

# ----
# forward kinematics
pt_3 = ConstructPoint(XCoordinate=0, YCoordinate=0, ZCoordinate=0)
pt_4 = Point(pt_3)
Y_3 = UnitY(Factor=Slider(-6, range=-100..100))
move_4 = Move(Geometry=pt_4, Motion=Y_3)  # -> Geometry, Transform
X_2 = UnitX(Factor=1)
rad_4 = Radians(Degrees=base)
cir_5 = Circle(Plane=pt_4, Radius="80.4")
number_slider_3 = Slider(19, range=0..100)
line_2 = LineSDL(Start=move_4.Geometry, Direction=X_2, Length=Slider(56, range=0..100))
rotate_4 = Rotate(Geometry=cir_5, Angle=rad_4, Plane=PlaneXY(0, 0, 0))  # -> Geometry, Transform
eval_7 = EvaluateCurve(Curve=rotate_4.Geometry, Parameter="0")  # -> Point, Tangent, Angle
ln_5 = Line(StartPoint=pt_4, EndPoint=eval_7.Point)
eval_8 = EvaluateLength(Curve=ln_5, Length=number_slider_3, Normalized=False)  # -> Point, Tangent, Parameter
cir_6 = Circle(Plane=eval_8.Point, Radius=Slider(25, range=0..100))
offset_2 = Offset(Curve=ln_5, Distance=expr("-d", Slider(10, range=0..100)), Plane=PlaneXY(0, 0, 0), Corners=1)
end_2 = EndPoints(Curve=offset_2)  # -> Start, End
Z_2 = UnitZ(Factor=1)
Y_4 = UnitY(Factor=1)
move_5 = Move(Geometry=eval_7.Point, Motion=Y_4)  # -> Geometry, Transform
pl_3pt_3 = Plane3Pt(PointA=eval_7.Point, PointB=pt_4, PointC=move_5.Geometry)
rad_5 = Radians(Degrees=elbow)
move_6 = Move(Geometry=eval_7.Point, Motion=Z_2)  # -> Geometry, Transform
pl_3pt_4 = Plane3Pt(PointA=eval_7.Point, PointB=pt_4, PointC=move_6.Geometry)
rad_6 = Radians(Degrees=90)
number_slider_4 = Slider(50, range=0..100)
rotate_5 = Rotate(Geometry=pl_3pt_4, Angle=rad_6, Plane=pl_3pt_3)  # -> Geometry, Transform
mirror_2 = Mirror(Geometry=pl_3pt_3, Plane=rotate_5.Geometry)  # -> Geometry, Transform
cir_7 = Circle(Plane=mirror_2.Geometry, Radius="88")
rotate_6 = Rotate(Geometry=cir_7, Angle=rad_5, Plane=mirror_2.Geometry)  # -> Geometry, Transform
eval_9 = EvaluateCurve(Curve=rotate_6.Geometry, Parameter="0")  # -> Point, Tangent, Angle
cir_8 = Circle(Plane=eval_9.Point, Radius="6")
ln_6 = Line(StartPoint=eval_7.Point, EndPoint=eval_9.Point)
eval_10 = EvaluateLength(Curve=ln_6, Length=Slider(19, range=0..100), Normalized=False)  # -> Point, Tangent, Parameter

eval_11 = EvaluateLength(Curve=line_2, Length=number_slider_3, Normalized=False)  # -> Point, Tangent, Parameter
eval_12 = EvaluateLength(Curve=offset_2, Length=Slider(13, range=0..100), Normalized=False)  # -> Point, Tangent, Parameter

ln_7 = Line(StartPoint=eval_11.Point, EndPoint=eval_8.Point)
dist_3 = Distance(PointA=eval_11.Point, PointB=eval_8.Point)
base_screw_length_2 = Panel(dist_3)
dist_4 = Distance(PointA=eval_10.Point, PointB=eval_12.Point)
elbow_screw_length_2 = Panel(dist_4)
ln_8 = Line(StartPoint=eval_12.Point, EndPoint=eval_10.Point)
