# Grasshopper definition doodle sim.ghx (Grasshopper 0.9.56)

pt = ConstructPoint(XCoordinate=0, YCoordinate=0, ZCoordinate=0)
pt_2 = Point(pt)
# forward kinematics
upper_arm = Slider(104.04, range=0..180)
lower_arm = Slider(33.84, range=0..90)
cir = Circle(Plane=pt_2, Radius="80.4")
rad = Radians(Degrees=lower_arm)
rotate = Rotate(Geometry=cir, Angle=rad, Plane=PlaneXY(0, 0, 0))  # -> Geometry, Transform
eval = EvaluateCurve(Curve=rotate.Geometry, Parameter="0")  # -> Point, Tangent, Angle
ln = Line(StartPoint=pt_2, EndPoint=eval.Point)
Z = UnitZ(Factor=1)
Y = UnitY(Factor=1)
move = Move(Geometry=eval.Point, Motion=Y)  # -> Geometry, Transform
pl_3pt = Plane3Pt(PointA=eval.Point, PointB=pt_2, PointC=move.Geometry)
rad_2 = Radians(Degrees=upper_arm)
move_2 = Move(Geometry=eval.Point, Motion=Z)  # -> Geometry, Transform
pl_3pt_2 = Plane3Pt(PointA=eval.Point, PointB=pt_2, PointC=move_2.Geometry)
rad_3 = Radians(Degrees=90)
rotate_2 = Rotate(Geometry=pl_3pt_2, Angle=rad_3, Plane=pl_3pt)  # -> Geometry, Transform
mirror = Mirror(Geometry=pl_3pt, Plane=rotate_2.Geometry)  # -> Geometry, Transform
cir_2 = Circle(Plane=mirror.Geometry, Radius="88")
rotate_3 = Rotate(Geometry=cir_2, Angle=rad_2, Plane=mirror.Geometry)  # -> Geometry, Transform
eval_2 = EvaluateCurve(Curve=rotate_3.Geometry, Parameter="0")  # -> Point, Tangent, Angle
ln_2 = Line(StartPoint=eval.Point, EndPoint=eval_2.Point)
pdecon = Deconstruct(Point=eval_2.Point)  # -> XComponent, YComponent, ZComponent
# inverse kinematics
# motor steps
# base motor : .18 degrees per step
# in one revolution 2000 steps
# 
# for 1 degree : 5.55 steps 88.8
x = Panel(pdecon.XComponent)
y = Panel(pdecon.YComponent)

# ----
# formulas used for inverse kinematics: float l1 = 80.4; // the length of the shoulder
#   float l2 = 88; // the length of the elbow
# 
# 
#   double cb2 = 2*l1*l2;
# 
#   double c2 = (sq(x) + sq(y) - sq(l1) - sq (l2)) / cb2;
#   double s2 = sqrt(1-sq(c2));
#   double k1 = (l1 + l2 * c2);
#   double k2 = (l2 * s2);
# 
#   double base_ang = rtod((atan2(y,x) - atan2(k2,k1)));
#   double elbow_ang = rtod(atan2(s2,c2)) + 90;
# 
#   myservo1.write(base_ang);
#   myservo2.write(elbow_ang);
pt_3 = ConstructPoint(XCoordinate=0, YCoordinate=0, ZCoordinate=0)

# ---- group: y
y_2 = Slider(128.394, range=0..150)
x_2 = Slider(89.094, range=0..150)
l1_shoulder = Number("80.4")
l2_elbow = Number("88")
x_3 = Number(x_2)
y_3 = Number(y_2)
cb2 = Evaluate(F="2*x*y", x=l1_shoulder, y=l2_elbow)
c2 = Evaluate(F="(x^2+y^2-l1^2-l2^2)/cb2", x=x_3, y=y_3, l1=l1_shoulder, l2=l2_elbow, cb2=cb2)
k1 = Evaluate(F="l1+l2*c2", l1=l1_shoulder, l2=l2_elbow, c2=c2)
s2 = Evaluate(F="(1-c2²)^.5", c2=c2)
k2 = Evaluate(F="l2*s2", l2=l2_elbow, s2=s2)
base_angle = Evaluate(F="deg(atan2(y,x)-atan2(k2,k1))", x=x_3, y=y_3, k1=k1, k2=k2)
elbow_angle = Evaluate(F="deg(atan2(s2,c2))", s2=s2, c2=c2)
panel = Panel(base_angle)
panel_2 = Panel(elbow_angle)

# ----
pt_4 = Point(pt_3)
# forward kinematics
panel_3 = Panel("80.4")
cir_3 = Circle(Plane=pt_4, Radius=panel_3)
rad_4 = Radians(Degrees=base_angle)
rotate_4 = Rotate(Geometry=cir_3, Angle=rad_4, Plane=PlaneXY(0, 0, 0))  # -> Geometry, Transform
eval_3 = EvaluateCurve(Curve=rotate_4.Geometry, Parameter="0")  # -> Point, Tangent, Angle
ln_3 = Line(StartPoint=pt_4, EndPoint=eval_3.Point)
Z_2 = UnitZ(Factor=1)
Y_2 = UnitY(Factor=1)
panel_4 = Panel("""35.92,96.26
35.44,96.211""")
move_3 = Move(Geometry=eval_3.Point, Motion=Y_2)  # -> Geometry, Transform
pl_3pt_3 = Plane3Pt(PointA=eval_3.Point, PointB=pt_4, PointC=move_3.Geometry)
rad_5 = Radians(Degrees=elbow_angle)
move_4 = Move(Geometry=eval_3.Point, Motion=Z_2)  # -> Geometry, Transform
pl_3pt_4 = Plane3Pt(PointA=eval_3.Point, PointB=pt_4, PointC=move_4.Geometry)
rad_6 = Radians(Degrees=90)
rotate_5 = Rotate(Geometry=pl_3pt_4, Angle=rad_6, Plane=pl_3pt_3)  # -> Geometry, Transform
mirror_2 = Mirror(Geometry=pl_3pt_3, Plane=rotate_5.Geometry)  # -> Geometry, Transform
cir_4 = Circle(Plane=mirror_2.Geometry, Radius="88")
rotate_6 = Rotate(Geometry=cir_4, Angle=rad_5, Plane=mirror_2.Geometry)  # -> Geometry, Transform
eval_4 = EvaluateCurve(Curve=rotate_6.Geometry, Parameter="0")  # -> Point, Tangent, Angle
ln_4 = Line(StartPoint=eval_3.Point, EndPoint=eval_4.Point)
cir_5 = Circle(Plane=eval_4.Point, Radius="6")
