# Grasshopper definition encoder.gh (Grasshopper 0.9.14)

pt = Point(<point referenced from the Rhino model>)
circle = Circle()
dom = Domain(DomainStart=Slider(0, range=0..100), DomainEnd=Slider(360, range=0..1000))
rectangle = Rectangle(Plane=pt, XSize=Slider(0.2, range=0..1), YSize=Slider(2, range=0..10), Radius=0)  # -> Rectangle, Length
range = Range(Domain=dom, Steps=Slider(150, range=0..200))
Y = UnitY(Factor=Slider(7.41, range=0..10))
move = Move(Geometry=rectangle.Rectangle, Motion=Y)  # -> Geometry, Transform
rad = Radians(Degrees=range)
cir = Circle(Plane=pt, Radius=expr("r/2", Slider(20, range=0..100)))
rotate = Rotate(Geometry=move.Geometry, Angle=rad, Plane=cir)  # -> Geometry, Transform
cir_2 = Circle(Plane=pt, Radius=expr("r/2", Slider(4, range=0..100)))
